# Requirement set F16A (R2024b)

## 1 [#1] F - Threat
Eliminate Threat

### 1.1 [#2] R - Detect
Aircraft needs to “detect” an enemy threat at a distance of 100 nautical miles

### 1.2 [#8] R - Target
Aircraft needs to "target" an enemy threat at a distance of 100 nautical miles

### 1.3 [#9] R - Engage
Aircraft needs to "engage" the enemy threat at a distance of 100 nautical miles

### 1.4 [#10] R - Verify
Aircraft needs to "verify" the enemy threat is eliminated

## 2 [#3] F- Structure/Loads
Ensure strength/durability across combat envelope

### 2.1 [#4] R-Structure
Design load limits +9 g / –3 g, withstand q = 2,133 psf, FoS = 1.5

## 3 [#5] F - Propulsion
High thrust-to-weight turbofan

### 3.1 [#6] R - Propulsion
Provide thrust for Mach 1.6 at 36,000 ft, sustained maneuvering, and rapid climb