% Simulink data dictionary F16A_Functional.sldd

FlightState = Simulink.Bus()
  Time_s: double
  Altitude_ft: double
  Mach: double
  WeightFraction: double

EngagementData = Simulink.Bus()
  TargetDetected: double
  TargetIdentified: double
  WeaponReleased: double