% Simulink data dictionary F16A_Logical.sldd

FuelFlow = Simulink.Bus()
  FuelRate_pph: double
  TankState_frac: double

ThrustVector = Simulink.Bus()
  Thrust_lbf: double

ControlCommand = Simulink.Bus()
  SurfaceDeflect_deg: double

TargetTrack = Simulink.Bus()
  Bearing_deg: double
  Range_nm: double