# Requirement set f16a_logical_derived (R2026a)
Design-decision requirements for the F-16A logical roles: recorded at the Logical layer (RFLP L) as the design decisions those roles embody, but DECIDED by the Physical-layer trade study (physical/F16APhysicalTradeStudy.m), which scores concrete parameterized candidates. L presents the options; P picks. Each requirement records which solution option was selected to realize a role, and why. Kept separate from the sizing-derived set (f16a.slreqx) and the functional-derived set (f16a_functional_derived.slreqx).

## 1 [REQ_F16A_LOGICAL] F-16A logical design decisions (Container)
Root container for the design decisions recorded against the Logical-layer roles. Each captures the selected option for a role that had multiple credible alternatives, with the rationale from the Physical-layer trade study that decided it.
Keywords: draft, derived, logical, decision

### 1.1 [REQ_F16A_L01] Propulsion: single-engine selection
The PropulsionSystem role shall be realized by a single afterburning turbofan (Pratt & Whitney F100 class), rather than a twin-engine installation. This is the production F-16A configuration and the outcome of the Lightweight Fighter (YF-16 vs YF-17) trade.
Rationale: Decided by the Physical-layer trade study (physical/F16APhysicalTradeStudy.m), which scores concrete parameterized engine candidates -- three of them: two single-engine and one twin-engine installation -- not numbers carried on the logical role. Score = weighted sum of declared value functions (Benefit/10, (TRL-1)/8, M_baseline/M against the role's Brandt baseline mass) with weights 0.50 / 0.25 / 0.25; unit cost is a pending Measure of Merit, left at NaN and excluded, with the remaining weights renormalized over the criteria that do have values -- so the classic single-vs-twin cost argument is stated here, not scored. The winning candidate takes the trade on technology readiness and installed mass DESPITE a mid-pack benefit score: this decision is carried by maturity and weight, not by raw capability, and it accepts lower engine-out survivability than a twin installation. The alternative (TwinEngine) is retained in the model as the traded option.
Keywords: draft, derived, logical, decision

### 1.2 [REQ_F16A_L02] Flight control: analog fly-by-wire selection
The FlightControlSystem role shall be realized by a (quad-redundant) analog fly-by-wire system enabling relaxed static stability, rather than a conventional hydro-mechanical control system. The F-16A was the first production fighter to fly a fly-by-wire flight control system.
Rationale: Decided by the Physical-layer trade study (physical/F16APhysicalTradeStudy.m), which scores concrete parameterized flight-control candidates, not numbers carried on the logical role. Score = weighted sum of declared value functions (Benefit/10, (TRL-1)/8, M_baseline/M against the role's Brandt baseline mass) with weights 0.50 / 0.25 / 0.25; unit cost is a pending Measure of Merit, left at NaN and excluded, with the remaining weights renormalized over the criteria that do have values -- so the higher acquisition cost of fly-by-wire is recorded here rather than scored. The fly-by-wire candidate wins on maneuver/agility benefit (it unlocks relaxed static stability and the associated turn performance) and on control-system mass, outweighing its lower technology readiness relative to hydro-mechanical linkages; it realizes the FlyByWire kind at L. The alternative (HydroMechanical) is retained in the model as the traded option.
Keywords: draft, derived, logical, decision

### 1.3 [REQ_F16A_L03] Airframe: blended cranked-delta wing selection
The Airframe role shall be realized by a cropped/cranked-delta blended wing-body with leading-edge root extensions (LERX), rather than a conventional trapezoidal wing on a discrete fuselage. This is the production F-16A configuration.
Rationale: Decided by the Physical-layer trade study (physical/F16APhysicalTradeStudy.m), which scores concrete parameterized airframe candidates, not numbers carried on the logical role. Score = weighted sum of declared value functions (Benefit/10, (TRL-1)/8, M_baseline/M against the role's Brandt baseline mass) with weights 0.50 / 0.25 / 0.25; unit cost is a pending Measure of Merit, left at NaN and excluded, with the remaining weights renormalized over the criteria that do have values -- so the higher aero-development cost of the blended configuration is recorded here rather than scored. The blended cranked-delta candidate wins on high-alpha / sustained-turn benefit and on structural efficiency (a lighter structure relative to the role's baseline mass), outweighing its lower technology readiness relative to a conventional trapezoidal wing on a discrete fuselage. The alternative (ConventionalTrapWing) is retained in the model as the traded option.
Keywords: draft, derived, logical, decision