% Requirement links of F16AFuelVerificationTest.m (R2026a)

% lines 23-45 verifies f16a_physical_derived.slreqx#2
        function setup(testCase)
            import matlab.unittest.fixtures.PathFixture
            % A PathFixture, not a bare addpath: the suite leaves the path as
            % it found it (D-047).
            testCase.applyFixture(PathFixture({f16aRoot(), fullfile(f16aRoot(),"physical")}));
            % Close only the model this suite's roll-up loads. bdclose("all")
            % would also discard whatever else the user had open.
            testCase.addTeardown(@() bdclose("F16A_Physical"));
        end
    end

    methods (Test)
        function testFuelSufficientForMission(testCase)
            % REQ_F16A_P01: available internal fuel shall be >= mission fuel.
            available = F16APhysicalFuelRollup().AvailableFuel_lb;
            required  = F16APhysicalMissionFuel();
            msg = sprintf("REQ_F16A_P01 VIOLATED: the aircraft carries %.0f lb of " + ...
                "internal fuel but the design mission needs %.0f lb, a shortfall " + ...
                "of %.0f lb. Both sides are real numbers, so this is a statement " + ...
                "about the aircraft: either the tanks or the mission has to " + ...
                "change.", available, required, required - available);
            testCase.verifyGreaterThanOrEqual(available, required, msg);
        end