% Requirement links of F16AMaterialsVerificationTest.m (R2026b)

% lines 27-44 verifies f16a.slreqx#28
        function testAirframeCompositeWithinLimit(testCase)
            % REQ_F16A_022: airframe composite fraction shall be <= 20%.
            cf = F16APhysicalMaterialsRollup().CompositeFraction;

            testCase.assertTrue(isfinite(cf), ...
                sprintf("REQ_F16A_022 UNEVALUATED: the materials roll-up returned %s, " + ...
                "not a number, so nothing was compared with the 20%% cap. This is a " + ...
                "broken analysis, not a violation -- check that every Material part " + ...
                "carries a readable Mass_lb and CompositeFraction.", num2str(cf)));

            testCase.verifyGreaterThan(cf, 0, ...
                "Composite roll-up returned 0 -- CompositeFraction properties not set?");
            testCase.verifyLessThanOrEqual(cf, 0.20, ...
                sprintf("REQ_F16A_022 NOT met: airframe composite fraction %.1f%% exceeds the 20%% cap.", ...
                100*cf));
        end
    end
end