% Requirement links of F16AStaticMarginVerificationTest.m (R2026b)

% lines 94-104 verifies f16a.slreqx#33
                string(num2str(testCase.Balance.SM_TO)) + "). This is a broken " + ...
                "analysis, not a requirement violation.");
            testCase.verifyTrue(isfinite(testCase.Balance.SM_land), ...
                "Static margin at landing is not finite (" + ...
                string(num2str(testCase.Balance.SM_land)) + "). This is a broken " + ...
                "analysis, not a requirement violation.");
        end

        function testTakeoffStaticMarginIsNegative(testCase)
            % The AFT end of the CG range -- heaviest, full fuel, full stores --
            % and so the LEAST stable end. Stores and fuel sit aft of the CG, so

% lines 104-115 verifies f16a.slreqx#33
            % and so the LEAST stable end. Stores and fuel sit aft of the CG, so
            % using them moves it forward. EXPECTED TO PASS.
            testCase.verifyThat(testCase.Balance.SM_TO, ...
                testCase.criterionConstraint(), ...
                testCase.criterionMessage("takeoff", testCase.Balance.SM_TO));
        end

        function testLandingStaticMarginIsNegative(testCase)
            % The FORWARD end: fuel burnt, stores released, and so the MOST
            % stable end. EXPECTED TO FAIL -- SM_land is positive and
            % REQ_F16A_025 is violated. "Across the operational CG range" is
            % what puts this end in scope: checking only takeoff verifies half a